# Grasshopper definition Robotic Simulation.gh (Grasshopper 1.0.7)
# plug-ins: Robots

setdo = SetDO(DO="1", Value=Toggle(False))
setdo_2 = SetDO(DO="1", Value=Toggle(True))

# ----
# 4 point XYZ calibration to be done
toggle = BooleanToggle(False)
setdo_3 = SetDO(DO="2", Value=toggle)
setdo_4 = SetDO(DO="2", Value=Toggle(True))

panel = Panel("""10
-30
20
20
20
0""")

crv = Curve([<curve referenced from the Rhino model> x7])
divide = DivideCurve(Curve=crv, Count=Slider(44, range=0..100), Kinks=False)  # -> Points, Tangents, Parameters
Z = UnitZ(Factor=1)
pl = ConstructPlane(Origin=divide.Points, XAxis=Vector(1, 0, 0), YAxis=Z)

crv_2 = Curve([<curve referenced from the Rhino model> x13])
divide_2 = DivideCurve(Curve=crv_2, Count=Slider(44, range=0..100), Kinks=False)  # -> Points, Tangents, Parameters
Z_2 = UnitZ(Factor=1)
pl_2 = ConstructPlane(Origin=divide_2.Points, XAxis=Vector(1, 0, 0), YAxis=Z_2)

# ----
# 4 point XYZ calibration to be done
panel_2 = Panel("0")
number_slider = Slider(119.23, range=-180..180)
points = PointList(Points=divide.Points, Size="10")
list = ValueList({"AA-KR60", "AA-KR30", "AA-KR60_KR30", "AARCH IRB120", "AARCH IRB6620", "AAU-Utzon-UR10", "Automata", "Bartlett-IRB120", "Bartlett-IRB1600", "Bartlett-KR6"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}, selected="iaac-IRB120")
brep = Brep(<brep referenced from the Rhino model>)
mesh = MeshBrep(
    Brep=brep,
    Settings={GridMaxCount=0, GridMinCount=16, JaggedSeams=False, MaxEdgeLength=0, MinEdgeLength=0.0001, MinTolerance=0, Refine=True, RefineAngle=0, RelativeTolerance=0.65, SimplePlanes=True, Tolerance=0})
mjoin = MeshJoin(Meshes=mesh)
load_robot = LoadRobotSystem(Name=list, Base=PlaneXY(0, 0, 0))
list_2 = ValueList({"Joint", "Linear"}, selected="Joint")
list_3 = ValueList({"Joint", "Linear"}, selected="Joint")
list_4 = ValueList({"Joint", "Linear"}, selected="Joint")
list_5 = ValueList({"Joint", "Linear"}, selected="Joint")

rot3d = Rotate3D(Geometry=pl, Angle=degrees(number_slider), Center=divide.Points, Axis=Vector(0, 0, 1))  # -> Geometry, Transform

rot3d_2 = Rotate3D(Geometry=pl_2, Angle=degrees(number_slider), Center=divide_2.Points, Axis=Vector(0, 0, 1))  # -> Geometry, Transform

pt = ConstructPoint(XCoordinate=panel_2, YCoordinate=panel_2, ZCoordinate="17")
pt_2 = Point(Point(0, 0, 0))
xy = XYPlane(Origin=pt_2)
pflip = FlipPlane(Plane=xy, ReverseX=False, ReverseY=False, SwapAxes=True)

# ---- group: rotating the tool
rotate = Rotate(Geometry=xy, Angle=degrees(Slider(0, range=0..90)), Plane=PlaneXY(0, 0, 0))  # -> Geometry, Transform

# ---- group: Incase of wrist singlularity
prot = RotatePlane(Plane=pflip, Angle=expr("-x", degrees(Slider(10, range=0..180))))

# ----
tool = CreateTool(Name="LED", TCP=prot, Weight=0, Mesh=mjoin)  # -> Tool, TCP

# ---- group: Start and End Joint position
merge = Merge(
    Data1=Slider(0, range=-180..180),
    Data2=Slider(-5, range=-180..180),
    Data3=Slider(-2, range=-180..180),
    Data4=Slider(-44, range=-180..180),
    Data5=Slider(-71, range=-180..180),
    Data6=Slider(80, range=-180..180))
degtorad = DegreesToRadians(Degrees=merge, RobotSystem=load_robot, MechanicalGroup=0)
target = CreateTarget(Joints=degtorad, Tool=tool.Tool, IsCartesian=False)

# ----
item = ListItem(List=rot3d.Geometry, Index=0, Wrap=True)  # -> Item1, Item
item_2 = ListItem(List=rot3d_2.Geometry, Index=0, Wrap=True)  # -> Item1, Item
target_2 = CreateTarget(Plane=rot3d.Geometry, Motion=list_4, Command=setdo_2, IsCartesian=True)
target_3 = CreateTarget(Plane=item.Item1, Motion=list_3, Command=setdo, IsCartesian=True)
target_4 = CreateTarget(Plane=rot3d_2.Geometry, Motion=list_2, Command=setdo_4, IsCartesian=True)
# 4 point XYZ calibration to be done
# 4 point XYZ calibration to be done
target_5 = CreateTarget(Plane=item_2.Item1, Motion=list_5, Command=setdo_3, IsCartesian=True)
entwine = Entwine(Branch00=target, Branch01=target_2, Branch02=target_3, Branch03=target_4, Branch04=target_5, FlattenInputs=True)

program = CreateProgram(Name="light_painting_wine", RobotSystem=load_robot, Targets1=flatten(entwine), StepSize=1)  # -> Program, Code, Duration, Warnings, Errors

sim = ProgramSimulation(Program=program.Program, Time=Slider(0, range=0..1), Normalized=True)  # -> SystemMeshes, JointRotations, Plane, Index, Time, Program, Errors
# 4 point XYZ calibration to be done
preview = CustomPreview(Geometry=sim.SystemMeshes, Material=ColourSwatch(SwatchColor=RGB(196, 255, 255)))
